# Grasshopper definition 301_toolpath_generator.ghx (Grasshopper 1.0.8)
# plug-ins: Heteroptera

# ---- group: This is needed only ONCE in the GH definition
enable_auto_reload = Python3Script()  # -> ok
# ---------- enable_auto_reload: Python ----------
"""
------------------------------
Using VS Code as Python editor
------------------------------

The simplest way to start using VS Code as our editor, is
to place our Python code in files located IN THE SAME FOLDER as our Grasshopper file.

After we have done that, we need 2 steps: 

1. Enable the COMPAS reloader on one component. This tells Grasshopper to watch for changes in the Pythoh files and reload if changed.
2. Every other component that uses Python code from external files needs to start with a method to ensure Grasshopper knows where to load the files from.

"""
# r: compas
# venv: mas-2526

from compas_rhino.devtools import DevTools
DevTools.enable_reloader()
# ---------- end enable_auto_reload ----------

# ----
geometry = Geometry([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])

# ---- group: wooden frame
custom_preview = CustomPreview(
    Geometry=geometry,
    Material={diffuse=RGB(221, 160, 221), emission=RGB(66, 48, 66), shine=0.5, specular=RGB(255, 255, 255), transparency=0})

# ----
point = Point(Point(0, 0, 0))
point_2 = Point(Point(0, 1000, 0))
point_3 = Point(Point(1000, 0, 0))
rectangle_3pt = Rectangle3Pt(PointA=point, PointB=point_3, PointC=point_2)  # -> Rectangle, Length
num_of_points = Slider(15, range=0..30)
length = Slider(600, range=0..700)
center = Center(Geometry=rectangle_3pt.Rectangle)  # -> Center, Dimension
save = Button()
# Generate Toolpath
toolpath_generator = Python3Script(center_pt=center.Center, length=length, num_of_points=num_of_points)  # -> out, geometries, way_planes; inputs center_pt: Point3d, length: Int32, num_of_points: Int32
# ---------- toolpath_generator: Python ----------
# r: compas
# venv: mas-2526

from compas.geometry import Frame
from compas.geometry import Line
from compas.geometry import Point
from compas.geometry import Vector
from compas.geometry import cross_vectors
from compas_rhino.conversions import point_to_compas
import math


path_dir = Vector(1.0, 0.0, 0.0)
path_direction = path_dir.unitized()

center_point = point_to_compas(center_pt)
start_point = center_point.translated(path_direction.scaled(-length / 2.0))

# Spray direction perpendicular to World XY
spray_direction = Vector(0.0, 0.0, -1.0)

points = []
point_spacing = length / (num_of_points - 1)




# # line #
# for index in range(num_of_points):
#     distance = index * point_spacing
#     point = start_point.translated(path_direction.scaled(distance))
#     points.append(point)

# # wavy line #
wave_amplitude = 200.0
num_of_waves = 1

# # Wave moves along World Y
# wave_dir = Vector(0.0, 1.0, 0.0)
# # wave_dir = Vector(0.0, 0.0, 1.0)
# wave_direction = wave_dir.unitized()

# for index in range(num_of_points):
#     distance = index * point_spacing
#     wave_angle = num_of_waves * 2.0 * math.pi * distance / length
#     wave_offset = wave_amplitude * math.sin(wave_angle)

#     point = start_point.translated(path_direction.scaled(distance))
#     point = point.translated(wave_direction.scaled(wave_offset))
#     points.append(point)

wave_dir = Vector(0.0, 0.0, 1.0)
wave_direction = wave_dir.unitized()

for index in range(num_of_points):
    distance = index * point_spacing
    wave_angle = num_of_waves * 2.0 * math.pi * distance / length

    # Offset stays between 0 and wave_amplitude
    wave_offset = wave_amplitude * 0.5 * (1.0 - math.cos(wave_angle))

    point = start_point.translated(
        path_direction.scaled(distance)
    )
    point = point.translated(
        wave_direction.scaled(wave_offset)
    )

    points.append(point)

# # circle #
# radius = length / 2.0
# circle_dir_x = Vector(1.0, 0.0, 0.0)
# circle_dir_y = Vector(0.0, 1.0, 0.0)

# for index in range(num_of_points):
#     angle = 2.0 * math.pi * index / (num_of_points - 1)

#     x_offset = radius * math.cos(angle)
#     y_offset = radius * math.sin(angle)

#     point = center_point.translated(circle_dir_x.scaled(x_offset))
#     point = point.translated(circle_dir_y.scaled(y_offset))
#     points.append(point)




geometries = []
for index in range(len(points) - 1):
    start = points[index]
    end = points[index + 1]

    line = Line(start, end)
    geometries.append(line)

way_planes = []
for point in points:
    xaxis = path_direction
    yaxis = Vector(*cross_vectors(spray_direction, xaxis)).unitized()

    frame = Frame(
        point=point,
        xaxis=xaxis,
        yaxis=yaxis,
    )
    way_planes.append(frame)


print("Toolpath length:", length, "mm")
print("Number of points:", len(points))
print("Number of line segments:", len(geometries))
print("Distance between points:", point_spacing, "mm")

for index, frame in enumerate(way_planes):
    print(
        "Waypoint",
        index,
        "| Point:",
        frame.point,
        "| Spray direction:",
        frame.zaxis,
    )
# ---------- end toolpath_generator ----------
python_3_script = Python3Script(frames=toolpath_generator.way_planes, pt_origin=point, pt_xaxis=point_3, pt_yaxis=point_2, save=save)  # inputs frames: list, pt_origin: Point3d, pt_xaxis: Point3d, pt_yaxis: Point3d
# ---------- python_3_script: Python ----------
from compas.data import json_dump
import sys
import os
from compas_rhino.conversions import point_to_compas

wobj_origin = point_to_compas(pt_origin)
wobj_xaxis = point_to_compas(pt_xaxis)
wobj_yaxis = point_to_compas(pt_yaxis)

data = {}

data["frames"] = frames
data["wobj_origin"] = wobj_origin
data["wobj_xaxis"] = wobj_xaxis
data["wobj_yaxis"] = wobj_yaxis


#get current file path
path = ghenv.Component.OnPingDocument().FilePath
#get parent directory of the parent directory
parentdir = os.path.dirname(path)
#get src folder which contains classes
dire = os.path.join(parentdir,'data')


filepath = os.path.join(dire, "toolpath_wave_z_direction.json")

if save:
    json_dump(data, filepath)
# ---------- end python_3_script ----------
compas_draw = COMPASDraw(cg=toolpath_generator.geometries)  # -> rg
#   port cg: The COMPAS geometry or datastructure to be drawn.
#   port rg: The Rhino geometry object.
# ---------- compas_draw: Python ----------
# r: compas>=2.14.1
"""
Draws COMPAS geometry in Grasshopper.
"""

from typing import Any

import Grasshopper

from compas.scene import SceneObject


class CompasToRhinoGeometry(Grasshopper.Kernel.GH_ScriptInstance):
    def RunScript(self, cg):
        if not cg:
            return None

        return SceneObject(item=cg).draw()
# ---------- end compas_draw ----------
compas_draw_2 = COMPASDraw(cg=toolpath_generator.way_planes)  # -> rg; same code as compas_draw
drawframe = Python3Script(x=toolpath_generator.way_planes)  # -> a; inputs x: list
# ---------- drawframe: Python ----------
from compas_rhino.conversions import frame_to_rhino_plane

a = [frame_to_rhino_plane(f) for f in x]
# ---------- end drawframe ----------
point_4 = Point(drawframe)
point_list = PointList(Points=point_4, Size="70")
