# Grasshopper definition 304_toolpath_generator_CT.gh (Grasshopper 1.0.8)

tile_2 = Geometry(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)
tile_3 = Geometry(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)
tile_4 = Geometry(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)
tile_5 = Geometry(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)
tile_6 = Geometry(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)
tile_1 = Geometry(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)
toolpath_1_1 = Curve(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)
toolpath_2_1 = Curve(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)
toolpath_3_1 = Curve(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)
toolpath_4_1 = Curve(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)
export_tiles = Python3Script(
    geometry=[tile_1, tile_2, tile_3, tile_4, tile_5, tile_6],
    save=Button(),
    density=Slider(66, range=0..100),
    quads=Toggle(False))  # -> out, face_count; inputs geometry: list of Brep, density: Int32, quads: Boolean
# ---------- export_tiles: Python ----------
import os
import Rhino.Geometry as rg

############## Inputs ##############
# geometry -> list of Brep (trimmed to the tile shape), in tile order
# density  -> int, target mesh density -- higher = finer/more regular (try 30)
# save     -> bool, Button

def make_nice_mesh(geo, density):
    brep = geo.ToBrep() if hasattr(geo, "ToBrep") else geo

    mp = rg.MeshingParameters()
    mp.GridAspectRatio = 1          # square-ish cells, not stretched
    mp.GridMinCount = density       # forces even density across the whole surface
    mp.GridAmplification = 1.0
    mp.JaggedSeams = False
    mp.RefineGrid = True

    pieces = rg.Mesh.CreateFromBrep(brep, mp)
    mesh = rg.Mesh()
    for piece in pieces:
        mesh.Append(piece)
    mesh.Vertices.CombineIdentical(True, True)
    mesh.Compact()
    mesh.Normals.ComputeNormals()
    return mesh

def write_obj(mesh, path):
    lines = []
    for v in mesh.Vertices:
        lines.append("v {0} {1} {2}".format(v.X, v.Y, v.Z))
    for f in mesh.Faces:
        if f.IsQuad:
            lines.append("f {0} {1} {2} {3}".format(f.A + 1, f.B + 1, f.C + 1, f.D + 1))
        else:
            lines.append("f {0} {1} {2}".format(f.A + 1, f.B + 1, f.C + 1))
    with open(path, "w") as out:
        out.write("\n".join(lines) + "\n")

lin_repo_root = r"C:\Users\cthorn\Documents\03_GitHub\Repos\Clones\SANDSKRIPT_depth-cam-to-robot"
out_dir = os.path.join(lin_repo_root, "surfaces")

saved_paths = []

if save:
    os.makedirs(out_dir, exist_ok=True)
    for i, geo in enumerate(geometry, start=1):
        mesh = make_nice_mesh(geo, density)
        path = os.path.join(out_dir, "tile_{0:03d}.obj".format(i))
        write_obj(mesh, path)
        saved_paths.append(path)
        print("Saved:", path)
# ---------- end export_tiles ----------

# ----
# toolpath_1.1
panel = Panel("100")
divide_curve = DivideCurve(Curve=toolpath_2_1, Count=panel, Kinks=False)  # -> Points, Tangents, Parameters
polyline = PolyLine(Vertices=divide_curve.Points, Closed=False)
point_list = PointList(Points=divide_curve.Points, Size="100")
pt = ConstructPoint(XCoordinate=0, YCoordinate=0, ZCoordinate=0)
py3 = Python3Script(
    points=divide_curve.Points,
    sphere_center=pt,
    safety_radius=Slider(1500, range=0..1600),
    target_radius=Slider(800, range=0..1600),
    t=Slider(0, range=0..1))  # -> target_sphere, sphere_center, safety_sphere, projected_curve, projected_points, tween_curve, tween_points, frames, rhino_planes, clipped_flags; inputs points: list of Point3d, sphere_center: Point3d, safety_radius: Double
# ---------- py3: Python ----------
from compas.geometry import Point, Polyline, Frame, Plane, Sphere
from compas_rhino.conversions import point_to_compas, frame_to_rhino

############## Inputs ##############
# points          -> Rhino Point3d list, curve A (original, on the net)
# sphere_center   -> Rhino Point3d
# target_radius   -> float, radius curve B (sphere-projected curve) lands on
# safety_radius   -> float, HARD LIMIT -- no tween point may end up farther than this from sphere_center
# t               -> float, 0.0-1.0 (0 = curve A, 1 = shape on sphere)

############## Convert Sphere Center ##############
center = point_to_compas(sphere_center)

############## Reference Shells (visualization only) ##############
target_sphere = Sphere(target_radius, point=center)
safety_sphere = Sphere(safety_radius, point=center)

############## Curve A: original points ##############
points_on_surface = [point_to_compas(pt) for pt in points]

############## Curve B: project curve A onto target shell ##############
projected_points = []
for point in points_on_surface:
    direction = point - center
    direction.unitize()
    projected_points.append(center + direction * target_radius)

projected_curve = Polyline(projected_points)

############## Lerp + Clamp to Safety Sphere ##############
tween_points = []
clipped_flags = []

for pa, pb in zip(points_on_surface, projected_points):
    blended = pa + (pb - pa) * t

    direction = blended - center
    distance_from_center = direction.length
    was_clipped = distance_from_center > safety_radius

    if was_clipped:
        direction.unitize()
        blended = center + direction * safety_radius

    tween_points.append(blended)
    clipped_flags.append(was_clipped)

tween_curve = Polyline(tween_points)

############## Compute Normals ##############
normal_vectors = []
for point in tween_points:
    normal = point - center
    normal.unitize()
    normal_vectors.append(normal)

############## Build Frames ##############
frames = []
rhino_planes = []
for point, normal in zip(tween_points, normal_vectors):
    plane = Plane(point, normal)
    frame = Frame.from_plane(plane)

    frames.append(frame)
    rhino_planes.append(frame_to_rhino(frame))

############## Output sphere_center as COMPAS point ##############
sphere_center = center
# ---------- end py3 ----------
compas_draw = COMPASDraw(cg=py3.tween_points)  # -> rg
#   port cg: The COMPAS geometry or datastructure to be drawn.
#   port rg: The Rhino geometry object.
# ---------- compas_draw: Python ----------
# r: compas>=2.14.1
"""
Draws COMPAS geometry in Grasshopper.
"""

from typing import Any

import Grasshopper

from compas.scene import SceneObject


class CompasToRhinoGeometry(Grasshopper.Kernel.GH_ScriptInstance):
    def RunScript(self, cg):
        if not cg:
            return None

        return SceneObject(item=cg).draw()
# ---------- end compas_draw ----------
point_list_2 = PointList(Points=compas_draw, Size="40")
panel_2 = Panel(py3.target_sphere)
save = Button()
compas_draw_2 = COMPASDraw(cg=py3.target_sphere)  # -> rg; same code as compas_draw
compas_draw_3 = COMPASDraw(cg=py3.safety_sphere)  # -> rg; same code as compas_draw
compas_draw_4 = COMPASDraw(cg=py3.projected_curve)  # -> rg; same code as compas_draw
compas_draw_5 = COMPASDraw(cg=py3.tween_curve)  # -> rg; same code as compas_draw
compas_draw_6 = COMPASDraw(cg=py3.frames)  # -> rg; same code as compas_draw
python_3_script = Python3Script(frames=py3.frames, save=save)  # inputs frames: list
# ---------- python_3_script: Python ----------
from compas.data import json_dump
import os

numbered_frames = []
for index, frame in enumerate(frames, start=0):
    numbered_frames.append({"number": index, "frame": frame})

data = {}
data["name"] = "toolpath_2.1"
data["coordinate_system"] = "wobj0"
data["units"] = "mm"
data["frames"] = numbered_frames

#get current file path
path = ghenv.Component.OnPingDocument().FilePath
#get parent directory of the parent directory
parentdir = os.path.dirname(path)
#get src folder which contains classes
dire = os.path.join(parentdir,'data')


filepath = os.path.join(dire, "toolpath_2.1.json")

if save:
    json_dump(data, filepath)
# ---------- end python_3_script ----------

# ----
# toolpath_2.1
panel_3 = Panel("100")
divide_curve_2 = DivideCurve(Curve=toolpath_2_1, Count=panel_3, Kinks=False)  # -> Points, Tangents, Parameters
polyline_2 = PolyLine(Vertices=divide_curve_2.Points, Closed=False)
point_list_3 = PointList(Points=divide_curve_2.Points, Size="100")
pt_2 = ConstructPoint(XCoordinate=0, YCoordinate=0, ZCoordinate=0)
py3_2 = Python3Script(
    points=divide_curve_2.Points,
    sphere_center=pt_2,
    safety_radius=Slider(1500, range=0..1600),
    target_radius=Slider(756, range=0..1600),
    t=Slider(0.25, range=0..1))  # -> target_sphere, sphere_center, safety_sphere, projected_curve, projected_points, tween_curve, tween_points, frames, rhino_planes, clipped_flags; inputs points: list of Point3d, sphere_center: Point3d, safety_radius: Double; same code as py3
compas_draw_7 = COMPASDraw(cg=py3_2.tween_points)  # -> rg; same code as compas_draw
point_list_4 = PointList(Points=compas_draw_7, Size="40")
panel_4 = Panel(py3_2.target_sphere)
save_2 = Button()
python_3_script_2 = Python3Script(frames=py3_2.frames, save=reverse(save_2))  # inputs frames: list; same code as python_3_script
compas_draw_8 = COMPASDraw(cg=py3_2.target_sphere)  # -> rg; same code as compas_draw
compas_draw_9 = COMPASDraw(cg=py3_2.safety_sphere)  # -> rg; same code as compas_draw
compas_draw_10 = COMPASDraw(cg=py3_2.projected_curve)  # -> rg; same code as compas_draw
compas_draw_11 = COMPASDraw(cg=py3_2.tween_curve)  # -> rg; same code as compas_draw
compas_draw_12 = COMPASDraw(cg=py3_2.frames)  # -> rg; same code as compas_draw

# ----
# toolpath_3.1
panel_5 = Panel("100")
divide_curve_3 = DivideCurve(Curve=toolpath_3_1, Count=panel_5, Kinks=False)  # -> Points, Tangents, Parameters
polyline_3 = PolyLine(Vertices=divide_curve_3.Points, Closed=False)
point_list_5 = PointList(Points=divide_curve_3.Points, Size="100")
pt_3 = ConstructPoint(XCoordinate=0, YCoordinate=0, ZCoordinate=0)
py3_3 = Python3Script(
    points=divide_curve_3.Points,
    sphere_center=pt_3,
    safety_radius=Slider(1500, range=0..1600),
    target_radius=Slider(756, range=0..1600),
    t=Slider(0.1, range=0..1))  # -> target_sphere, sphere_center, safety_sphere, projected_curve, projected_points, tween_curve, tween_points, frames, rhino_planes, clipped_flags; inputs points: list of Point3d, sphere_center: Point3d, safety_radius: Double; same code as py3
compas_draw_13 = COMPASDraw(cg=py3_3.tween_points)  # -> rg; same code as compas_draw
point_list_6 = PointList(Points=compas_draw_13, Size="40")
panel_6 = Panel(py3_3.target_sphere)
save_3 = Button()
compas_draw_14 = COMPASDraw(cg=py3_3.target_sphere)  # -> rg; same code as compas_draw
compas_draw_15 = COMPASDraw(cg=py3_3.safety_sphere)  # -> rg; same code as compas_draw
compas_draw_16 = COMPASDraw(cg=py3_3.projected_curve)  # -> rg; same code as compas_draw
compas_draw_17 = COMPASDraw(cg=py3_3.tween_curve)  # -> rg; same code as compas_draw
compas_draw_18 = COMPASDraw(cg=py3_3.frames)  # -> rg; same code as compas_draw
python_3_script_3 = Python3Script(frames=py3_3.frames, save=save_3)  # inputs frames: list
# ---------- python_3_script_3: Python ----------
from compas.data import json_dump
import os

numbered_frames = []
for index, frame in enumerate(frames, start=0):
    numbered_frames.append({"number": index, "frame": frame})

data = {}
data["name"] = "toolpath_3.1"
data["coordinate_system"] = "wobj0"
data["units"] = "mm"
data["frames"] = numbered_frames

#get current file path
path = ghenv.Component.OnPingDocument().FilePath
#get parent directory of the parent directory
parentdir = os.path.dirname(path)
#get src folder which contains classes
dire = os.path.join(parentdir,'data')


filepath = os.path.join(dire, "toolpath_3.1.json")

if save:
    json_dump(data, filepath)
# ---------- end python_3_script_3 ----------

# ----
# toolpath_4.1
panel_7 = Panel("100")
divide_curve_4 = DivideCurve(Curve=toolpath_4_1, Count=panel_7, Kinks=False)  # -> Points, Tangents, Parameters
polyline_4 = PolyLine(Vertices=divide_curve_4.Points, Closed=False)
point_list_7 = PointList(Points=divide_curve_4.Points, Size="100")
pt_4 = ConstructPoint(XCoordinate=0, YCoordinate=0, ZCoordinate=0)
py3_4 = Python3Script(
    points=divide_curve_4.Points,
    sphere_center=pt_4,
    safety_radius=Slider(1500, range=0..1600),
    target_radius=Slider(756, range=0..1600),
    t=Slider(0.1, range=0..1))  # -> target_sphere, sphere_center, safety_sphere, projected_curve, projected_points, tween_curve, tween_points, frames, rhino_planes, clipped_flags; inputs points: list of Point3d, sphere_center: Point3d, safety_radius: Double; same code as py3
compas_draw_19 = COMPASDraw(cg=py3_4.tween_points)  # -> rg; same code as compas_draw
point_list_8 = PointList(Points=compas_draw_19, Size="40")
panel_8 = Panel(py3_4.target_sphere)
save_4 = Button()
compas_draw_20 = COMPASDraw(cg=py3_4.target_sphere)  # -> rg; same code as compas_draw
compas_draw_21 = COMPASDraw(cg=py3_4.safety_sphere)  # -> rg; same code as compas_draw
compas_draw_22 = COMPASDraw(cg=py3_4.projected_curve)  # -> rg; same code as compas_draw
compas_draw_23 = COMPASDraw(cg=py3_4.tween_curve)  # -> rg; same code as compas_draw
compas_draw_24 = COMPASDraw(cg=py3_4.frames)  # -> rg; same code as compas_draw
python_3_script_4 = Python3Script(frames=py3_4.frames, save=save_4)  # inputs frames: list
# ---------- python_3_script_4: Python ----------
from compas.data import json_dump
import os

numbered_frames = []
for index, frame in enumerate(frames, start=0):
    numbered_frames.append({"number": index, "frame": frame})

data = {}
data["name"] = "toolpath_4.1"
data["coordinate_system"] = "wobj0"
data["units"] = "mm"
data["frames"] = numbered_frames

#get current file path
path = ghenv.Component.OnPingDocument().FilePath
#get parent directory of the parent directory
parentdir = os.path.dirname(path)
#get src folder which contains classes
dire = os.path.join(parentdir,'data')


filepath = os.path.join(dire, "toolpath_4.1.json")

if save:
    json_dump(data, filepath)
# ---------- end python_3_script_4 ----------

py3_5 = Python3Script(curve=toolpath_3_1, count="100", save=Button(), tile_id=Slider(2, range=0..10))  # -> preview_planes, c; inputs curve: Curve, count: Int32, save: Boolean, tile_id: Int32
# ---------- py3_5: Python ----------
import os
import json
from datetime import datetime
import Rhino.Geometry as rg

############## Inputs ##############
# curve   -> Rhino Curve, the toolpath curve to export (curve A, on the double-curved surface)
# count   -> int, number of division points along the curve
# tile_id -> int, optional -- which tile this path belongs to. Leave
#            unconnected to save without a tile_id.
# save    -> bool, Button -- writes the file only when True

############## Divide Curve ##############
params = curve.DivideByCount(count, True)
points = [curve.PointAt(t) for t in params]
tangents = [curve.TangentAt(t) for t in params]

############## Build Frames ##############
world_z = rg.Vector3d(0, 0, 1)

stroke = []
preview_planes = []

for point, tangent in zip(points, tangents):
    xaxis = rg.Vector3d(tangent)
    xaxis.Unitize()

    yaxis = rg.Vector3d.CrossProduct(world_z, xaxis)
    if yaxis.Length < 1e-6:
        yaxis = rg.Vector3d.CrossProduct(rg.Vector3d(1, 0, 0), xaxis)
    yaxis.Unitize()

    stroke.append({
        "plane": {
            "origin": [point.X, point.Y, point.Z],  # already mm, no conversion
            "xaxis": [xaxis.X, xaxis.Y, xaxis.Z],
            "yaxis": [yaxis.X, yaxis.Y, yaxis.Z],
        }
    })
    preview_planes.append(rg.Plane(point, xaxis, yaxis))

data = {"strokes": [stroke]}
if tile_id is not None:
    data["tile_id"] = tile_id

############## Build Output Path ##############
repo_root = r"C:\Users\cthorn\Documents\03_GitHub\Repos\Clones\sandskript_sybil_rrc_dev"
timestamp = datetime.now().strftime("%Y-%m-%d_%H-%M-%S")
out_dir = os.path.join(repo_root, "data", "in", timestamp)
out_path = os.path.join(out_dir, "path.json")

filepath = out_path

############## Save ##############
if save:
    os.makedirs(out_dir, exist_ok=True)
    with open(out_path, "w") as f:
        json.dump(data, f, indent=4)
    print("Saved toolpath:")
    print(out_path)
    print("Tile ID:", tile_id)
# ---------- end py3_5 ----------
panel_9 = Panel(py3_5.c)
pt_5 = Point(<point referenced from the Rhino model>)
sphere = Geometry(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)
tile_2_2 = Geometry(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)
tile_1_2 = Geometry(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)
tile_3_2 = Geometry(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)
toolpath_1 = Curve(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)
toolpath_2 = Curve(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)
toolpath_3 = Curve(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)

divide_curve_5 = DivideCurve(Curve=toolpath_3, Count="20", Kinks=False)  # -> Points, Tangents, Parameters
python_3_script_5 = Python3Script(points=divide_curve_5.Points)  # -> out, projected_curve, projected_points, frames, rhino_planes; inputs points: list of Point3d
# ---------- python_3_script_5: Python ----------
from compas.geometry import Point, Sphere, Polyline, Frame, Plane
from compas_rhino.conversions import point_to_compas, vector_to_rhino, frame_to_rhino

############## Sphere Center ##############
sphere_center = Point(0, 100, 100)

############## Sphere ##############
sphere = Sphere(1400, point=sphere_center)

############## Convert Input Points ##############
compas_points = []
for point in points:
    compas_points.append(point_to_compas(point))

############## Project Points onto Sphere ##############
projected_points = []
for point in compas_points:
    direction = point - sphere_center
    direction.unitize()
    projected_points.append(sphere_center + direction * sphere.radius)

projected_curve = Polyline(projected_points)

############## Compute Normals ##############
normal_vectors = []
for point in projected_points:
    normal = point - sphere_center
    normal.unitize()
    normal_vectors.append(normal)

############## Build Frames ##############
frames = []
rhino_planes = []
for point, normal in zip(projected_points, normal_vectors):
    plane = Plane(point, normal)
    frame = Frame.from_plane(plane)

    frames.append(frame)
    rhino_planes.append(frame_to_rhino(frame))
# ---------- end python_3_script_5 ----------
polyline_5 = PolyLine(Vertices=divide_curve_5.Points, Closed=False)
# toolpath_3
point_list_9 = PointList(Points=divide_curve_5.Points, Size="100")
compas_draw_25 = COMPASDraw(cg=python_3_script_5.projected_curve)  # -> rg; same code as compas_draw
compas_draw_26 = COMPASDraw(cg=python_3_script_5.projected_points)  # -> rg; same code as compas_draw
compas_draw_27 = COMPASDraw(cg=python_3_script_5.frames)  # -> rg; same code as compas_draw
point_list_10 = PointList(Points=compas_draw_26, Size="50")
save_5 = Button()
python_3_script_6 = Python3Script(frames=python_3_script_5.frames, save=save_5)  # inputs frames: list
# ---------- python_3_script_6: Python ----------
from compas.data import json_dump
import os

numbered_frames = []
for index, frame in enumerate(frames, start=0):
    numbered_frames.append({"number": index, "frame": frame})

data = {}
data["name"] = "toolpath_3"
data["coordinate_system"] = "wobj0"
data["units"] = "mm"
data["frames"] = numbered_frames

#get current file path
path = ghenv.Component.OnPingDocument().FilePath
#get parent directory of the parent directory
parentdir = os.path.dirname(path)
#get src folder which contains classes
dire = os.path.join(parentdir,'data')


filepath = os.path.join(dire, "toolpath_3.json")

if save:
    json_dump(data, filepath)
# ---------- end python_3_script_6 ----------

divide_curve_6 = DivideCurve(Curve=toolpath_1, Count="20", Kinks=False)  # -> Points, Tangents, Parameters
python_3_script_7 = Python3Script(points=divide_curve_6.Points)  # -> out, projected_curve, projected_points, frames, rhino_planes, sphere; inputs points: list of Point3d; same code as python_3_script_5
polyline_6 = PolyLine(Vertices=divide_curve_6.Points, Closed=False)
# toolpath_1
point_list_11 = PointList(Points=divide_curve_6.Points, Size="100")
compas_draw_28 = COMPASDraw(cg=python_3_script_7.projected_curve)  # -> rg; same code as compas_draw
compas_draw_29 = COMPASDraw(cg=python_3_script_7.projected_points)  # -> rg; same code as compas_draw
compas_draw_30 = COMPASDraw(cg=python_3_script_7.frames)  # -> rg; same code as compas_draw
point_list_12 = PointList(Points=compas_draw_29, Size="50")
save_6 = Button()
python_3_script_8 = Python3Script(frames=python_3_script_7.frames, save=save_6)  # inputs frames: list
# ---------- python_3_script_8: Python ----------
from compas.data import json_dump
import os

numbered_frames = []
for index, frame in enumerate(frames, start=0):
    numbered_frames.append({"number": index, "frame": frame})

data = {}
data["name"] = "toolpath_1"
data["coordinate_system"] = "wobj0"
data["units"] = "mm"
data["frames"] = numbered_frames

#get current file path
path = ghenv.Component.OnPingDocument().FilePath
#get parent directory of the parent directory
parentdir = os.path.dirname(path)
#get src folder which contains classes
dire = os.path.join(parentdir,'data')


filepath = os.path.join(dire, "toolpath_1.json")

if save:
    json_dump(data, filepath)
# ---------- end python_3_script_8 ----------

divide_curve_7 = DivideCurve(Curve=toolpath_2, Count="20", Kinks=False)  # -> Points, Tangents, Parameters
python_3_script_9 = Python3Script(points=divide_curve_7.Points)  # -> out, projected_curve, projected_points, frames, rhino_planes; inputs points: list of Point3d; same code as python_3_script_5
polyline_7 = PolyLine(Vertices=divide_curve_7.Points, Closed=False)
# toolpath_2
point_list_13 = PointList(Points=divide_curve_7.Points, Size="100")
compas_draw_31 = COMPASDraw(cg=python_3_script_9.projected_curve)  # -> rg; same code as compas_draw
compas_draw_32 = COMPASDraw(cg=python_3_script_9.projected_points)  # -> rg; same code as compas_draw
compas_draw_33 = COMPASDraw(cg=python_3_script_9.frames)  # -> rg; same code as compas_draw
point_list_14 = PointList(Points=compas_draw_32, Size="50")
save_7 = Button()
python_3_script_10 = Python3Script(frames=python_3_script_9.frames, save=save_7)  # inputs frames: list
# ---------- python_3_script_10: Python ----------
from compas.data import json_dump
import os

numbered_frames = []
for index, frame in enumerate(frames, start=0):
    numbered_frames.append({"number": index, "frame": frame})

data = {}
data["name"] = "toolpath_2"
data["coordinate_system"] = "wobj0"
data["units"] = "mm"
data["frames"] = numbered_frames

#get current file path
path = ghenv.Component.OnPingDocument().FilePath
#get parent directory of the parent directory
parentdir = os.path.dirname(path)
#get src folder which contains classes
dire = os.path.join(parentdir,'data')


filepath = os.path.join(dire, "toolpath_2.json")

if save:
    json_dump(data, filepath)
# ---------- end python_3_script_10 ----------

compas_draw_34 = COMPASDraw(cg=python_3_script_7.sphere)  # -> rg; same code as compas_draw
